% Simulink data dictionary EPOS4.sldd

x520886_fDIncrEnc = Simulink.Parameter(6250000, DataType="double", Min=0, Max=6250000, Unit="Hz")  % For

x520886_ICont = Simulink.Parameter(15, DataType="double", Min=-30, Max=30, Unit="A")  % Continuous output current
  % For more information, visit EPOS4 Application Notes Collection Edition 2021-03

x520886_Ts = Simulink.Parameter(20, DataType="double", Min=0, Unit="ms")  % Controlled sample time
  % For Cyclic Synchronous Current mode: Ts = 0.04ms
  % For Cyclic Synchronous Position mode: Ts = 20ms
  % For Cyclic Synchronous Velocity mode Ts = 20ms
  % During a movement within a drive system, forces and/or torques must be controlled.
  % Therefore, as a principal regulation structure, EPOS4 offers current-based control
  % For more information, visit EPOS4 Application Notes Collection Edition 2021-03